% Simulink data dictionary simulation_interfaces.sldd

SimRealState = Simulink.Bus()
  x_m: double
  y_m: double
  psi_rad: double
  dPsi_radps: double
  vx_mps: double
  vy_mps: double
  ax_mps2: double
  ay_mps2: double
  nWheelFL_rad: double
  nWheelFR_rad: double
  nWheelRL_rad: double
  nWheelRR_rad: double

DriveForce_N = Simulink.Bus()
  DriveForce_act_N_FL: double, Unit="N"
  DriveForce_act_N_FR: double, Unit="N"
  DriveForce_act_N_RL: double, Unit="N"
  DriveForce_act_N_RR: double, Unit="N"

V2X_Vehicle_Sim = Simulink.Bus()
  x_m: double
  y_m: double
  psi_rad: double
  vx_mps: double
  vy_mps: double
  dPsi_radps: double

VehicleParameterSet = Simulink.Bus()
  cLiftF: double
  cLiftR: double
  CoGx_m: double
  CoGy_m: double
  CoGz_m: double
  cDrag: double
  Aref_m2: double
  Gearratio: double
  Wheelbase_m: double
  PacLatF: double[5]
  PacLongF: double[5]
  PacLatR: double[5]
  PacLongR: double[5]
  cRollFriction_Npmps: double
  MaxRollFriction_N: double
  T_YawRate_s: double
  T_LatVel_s: double
  TrackWidthF_m: double
  TrackWidthR_m: double
  TireRadiusF_m: double
  TireRadiusR_m: double
  VehicleInertia_kgm2: double
  WheelInertiaF_kgm2: double
  WheelInertiaR_kgm2: double
  VehicleMass_kg: double
  switchModelBlend_mps: double
  PTLimitLowVel_N: double
  switchModelVel_mps: double
  T_Tire_s: double