% Simulink data dictionary simulation_modelconfig.sldd

tSPhysics = 0.002
Physics_Speedgoat = Simulink.ConfigSet(StartTime="0", StopTime="inf", FixedStep="tSPhysics", Solver="ode2", ProdHWDeviceType="Generic->32-bit x86 compatible", SystemTargetFile="slrt.tlc", TargetLang="C")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
Physics_GRT = Simulink.ConfigSet(StartTime="0", StopTime="500", FixedStep="tSPhysics", Solver="ode2", ProdHWDeviceType="Generic->32-bit x86 compatible", SystemTargetFile="grt.tlc", TargetLang="C")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
Physics = Simulink.ConfigSet(StartTime="0", StopTime="500", FixedStep="tSPhysics", Solver="ode2", ProdHWDeviceType="Generic->32-bit x86 compatible", SystemTargetFile="grt.tlc", TargetLang="C")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